# Dynamo graph ProjectFoldersCreator.dyn (Dynamo 2.0.2.6826)

# group: BEST PRACTICE GUIDE
# note: GUIDE
# 1. DIVIDE THE DYNAMO DEFINITION INTO THE USER INTERFACE AND THE BACK-END
# 2. BUILD THE DEFINITION WITH SMALL BLOCKS
# 3. COLOR-CODE BLOCKS ACCORDING TO THE TEMPLATE
# 4. ALWAYS WRITE CONCISE INSTRUCTIONS ON HOW TO RUN THE SCRIPT
# 5. ALWAYS COMPILE INFO
# 6. GROUPS NAMING CONVENTION:
# <USE>_<AFFECTED ELEMENTS/GEOMETRY>

# group: MODIFY PARAMETERS
# note: USE:
# WHEN MODIFYING PARAMETERS OF REVIT ELEMENTS
# note: PARAMETERS

# group: TEMPORARY
# note: USE:
# WIP TEMPORAY PARTS THAT HELP IN DEVELOPING
# THE SCRIPT BUT ARE NOT PART OF THE FINAL WORKFLOW
# note: WIP

# group: ELEMENTS COLLECTOR
# note: USE:
# NODES THAT REFERENCE/COLLECT REVIT ELEMENTS
# INSIDE OF DYNAMO
# note: COLLECTORS

# group: GET PARAMETERS
# note: USE:
# WHEN QUERYING PARAMETERS OF REVIT ELEMENTS
# note: PARAMETERS

# group: REVIT ACTION
# note: USE:
# CREATE ELEMENTS IN THE REVIT ENVIRONMENT
# note: CREATION

# group: ANNOTATION
# note: USE:
# FOR COMMENTS
# note: ANNOTATION

# group: U.I.
# note: USE:
# USER INPUTS TO BE FILLED IN TO RUN THE SCRIPT OR WHAT THE USER WANTS TO SEE
# note: USER INTERFACE

# group: INFO
# note: CREATED BY: AT
# MODIFIED BY: --
# STARTING DATE: 21/09/2017
# FINISHING DATE: 21/09/2017
# DYNAMO VERSION: <Dynamo 1.3.0>
# PACKAGES USED:
# PROJECT SPECIFIC:
# NO

# group: INSTRUCTIONS
# note: COPY THE PROJECT FOLDER PATH TO "Project Folder" BEFORE RUNNING

# group: DYNAMO ACTION
# note: CREATION
# note: USE:
# CREATE ELEMENTS IN THE DYNAMO ENVIRONMENT

# group: WRITE
# note: OUTPUT
# note: USE:
# WRITE DATA IN EXTERNAL FILES SUCH AS EXCEL, CSV, NOTES, WORD, ETC.

# group: Project Folder
string = StringInput("C:\temp")  # graph input

code_block = CodeBlock(PROJFOLD=string) { PROJFOLD + "\\A11\\" + "CD00_Automations\\"; }
fromPath = DirectoryObject(path=code_block)  # "Directory.FromPath"
code_block_2 = CodeBlock(AUTO=fromPath)
# ---------- code_block_2.designscript (6 lines) ----------
AUTO + "01_Input\\";
AUTO + "02_WIP\\";
AUTO + "03_ScriptsRepository\\";
AUTO + "04_Output\\";
AUTO + "05_Resources\\";
AUTO + "06_Storage\\";
# ----------------------------------------
fromPath_2 = DirectoryObject(path=code_block_2.out4)  # "Directory.FromPath"
fromPath_3 = DirectoryObject(path=code_block_2.out0)  # "Directory.FromPath"
code_block_3 = CodeBlock(INPUT=fromPath_3) { INPUT + "YYMMDD_WHAT_NS_VIA\\"; }
fromPath_4 = DirectoryObject(path=code_block_3)  # "Directory.FromPath"
fromPath_5 = DirectoryObject(path=code_block_2.out1)  # "Directory.FromPath"
code_block_4 = CodeBlock(WIP=fromPath_5) { WIP + "YYMMDD_WHAT\\"; }
fromPath_6 = DirectoryObject(path=code_block_4)  # "Directory.FromPath"
fromPath_7 = DirectoryObject(path=code_block_2.out2)  # "Directory.FromPath"
code_block_5 = CodeBlock(REPO=fromPath_7) { REPO + "YYMMDD_WHAT\\"; }
fromPath_8 = DirectoryObject(path=code_block_5)  # "Directory.FromPath"
fromPath_9 = DirectoryObject(path=code_block_2.out3)  # "Directory.FromPath"
code_block_6 = CodeBlock(OUTPUT=fromPath_9) { OUTPUT + "YYMMDD_WHAT_NS_VIA\\"; }
fromPath_10 = DirectoryObject(path=code_block_6)  # "Directory.FromPath"
fromPath_11 = DirectoryObject(path=code_block_2.out5)  # "Directory.FromPath"
code_block_7 = CodeBlock(OUTPUT=fromPath_11) { OUTPUT + "YYMMDD\\"; }
fromPath_12 = DirectoryObject(path=code_block_7)  # "Directory.FromPath"
